# Dynamo graph 3DPOLY BUILDER - VETORIZAÇÃO.dyn (Dynamo 3.3.1.7726)
# author: Carlos M. G. Oliveira
# Automação avançada para a criação de Polilinhas 3D fundamentada na lógica de seções transversais. O algoritmo identifica padrões de repetição na sequência de pontos do AutoCAD (ex: sequências de 3 em 3 pontos) para gerar múltiplas linhas longitudinais paralelas de forma simultânea e organizada. Essencial para transformar levantamentos de campo brutos em modelos de arame (wireframes) precisos para estradas, canais e taludes, garantindo a continuidade perfeita entre as seções.

# group: Seleção de dados
n2_selecionar_conjunto_de_pontos = ObjectsSelection()  # "2. SELECIONAR CONJUNTO DE PONTOS"; 85 picked in the model; graph input
n1_definina_o_layer_do_ponto = ObjectSelection()  # "1. DEFININA O LAYER DO PONTO"; 1 picked in the model; graph input
n3_seção_inicial = ObjectsSelection()  # "3. SEÇÃO INICIAL"; 3 picked in the model; graph input
n4_layer_da_3dpoly = ListLayerName("0", ItemList=["0", "ARV", "BD", "BL", "BL_F", "BLF", "CANALETA_FIM", "CANALETA_INICIO", "CONT-CR", "CONT-PE"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])  # "4. LAYER DA 3DPOLY"; graph input

geometry = Autodesk.AutoCAD.DynamoNodes.Object.Geometry(object=n2_selecionar_conjunto_de_pontos)
layer = Autodesk.AutoCAD.DynamoNodes.Object.Layer(object=n1_definina_o_layer_do_ponto)
layer_2 = Autodesk.AutoCAD.DynamoNodes.Object.Layer(object=n2_selecionar_conjunto_de_pontos)
eq = layer == layer_2
filterByBoolMask = List.FilterByBoolMask(list=geometry, mask=eq)
geometry_2 = Autodesk.AutoCAD.DynamoNodes.Object.Geometry(object=n3_seção_inicial)
python_ordenacao = Python(IN[0]=filterByBoolMask.in, IN[1]=geometry_2)  # CPython3
# ---------- python_ordenacao.python (126 lines) ----------
import clr
import sys
clr.AddReference('ProtoGeometry')
from Autodesk.DesignScript.Geometry import Point, Vector

# ==========================================
# 1. INPUTS DA INTERFACE
# ==========================================
raw_pool = IN[0] if isinstance(IN[0], list) else [IN[0]]
seed_section = IN[1] if isinstance(IN[1], list) else [IN[1]]

def get_centroid(pts):
    if not pts: return None
    return Point.ByCoordinates(sum(p.X for p in pts)/len(pts), 
                               sum(p.Y for p in pts)/len(pts), 
                               sum(p.Z for p in pts)/len(pts))

# Faxina contra duplo clique do topógrafo (pontos a menos de 1cm)
pool = []
for p in raw_pool:
    if not any(p.DistanceTo(up) < 0.01 for up in pool): pool.append(p)

# Retira os pontos iniciais da piscina
pool = [p for p in pool if not any(p.DistanceTo(s) < 0.01 for s in seed_section)]

# Trava de segurança caso a entrada venha vazia
if not seed_section or not pool:
    OUT = [[], []]
    sys.exit()

# ==========================================
# 2. AUTO-CALIBRAÇÃO MACIA (Elástico)
# ==========================================
# Pega a largura máxima da sua seção (a rua inteira)
conduit_width = max([s1.DistanceTo(s2) for s1 in seed_section for s2 in seed_section])

# A BLINDAGEM DA LARGURA MÍNIMA:
# Nunca deixa o conduíte ter menos de 2.5 metros de base de cálculo.
# Isso impede que o "Paredão de Borracha" fique espremido demais se a seção inicial for pequena.
if conduit_width < 2.5: 
    conduit_width = 2.5 

# Define o vetor guia inicial
seed_centroid = get_centroid(seed_section)
pool.sort(key=lambda p: p.DistanceTo(seed_centroid))
next_centroid = get_centroid(pool[:len(seed_section)])

if seed_centroid.DistanceTo(next_centroid) > 0.1:
    initial_vector = Vector.ByTwoPoints(seed_centroid, next_centroid).Normalized()
else:
    initial_vector = Vector.ByCoordinates(0, 1, 0)

# ==========================================
# 3. RASTREADOR (Cães Adestrados)
# ==========================================
wires = [[s] for s in seed_section]
current_vectors = [initial_vector for _ in seed_section]
active_wires = [True for _ in seed_section]
error_pts = []

while any(active_wires) and len(pool) > 0:
    for i, wire in enumerate(wires):
        if not active_wires[i]: continue

        p_curr = wire[-1]
        v_curr = current_vectors[i]
        
        best_p = None
        best_score = float('inf')

        for p_test in pool:
            dist = p_curr.DistanceTo(p_test)
            vec_to_test = Vector.ByTwoPoints(p_curr, p_test)
            if vec_to_test.Length < 0.01: continue
            
            vec_to_test_norm = vec_to_test.Normalized()
            
            # DOT PRODUCT: 1 = Reto, 0 = 90 graus, -1 = Para trás
            dot = v_curr.Dot(vec_to_test_norm)
            if dot < 0.0: continue # Ignora totalmente se o ponto estiver pra trás

            cross_vec = v_curr.Cross(vec_to_test)
            deviation = cross_vec.Length

            # ==========================================
            # REGRA DO PAREDÃO DE BORRACHA:
            # Multiplicador 1.15 dá margem para curvas sem pular pra outra rua.
            # Como a conduit_width tem o mínimo de 2.5m, o desvio lateral
            # máximo permitido será sempre de no mínimo ~2.8m.
            # ==========================================
            if deviation > (conduit_width * 1.4): continue

            # A NOTA MAGNÉTICA (AGORA COM MULTA DE FAIXA):
            # Distância pesa e curva pesa...
            angle_penalty = (1.0 - dot) * (conduit_width * 3.0)
            
            # ... MAS O DESVIO LATERAL PESA MUITO MAIS! (Multa de 5x)
            # Isso impede ele de roubar o ponto do vizinho, forçando ele a ficar na reta.
            deviation_penalty = deviation * 5.0 
            
            score = dist + angle_penalty + deviation_penalty
            # ==========================================

            if score < best_score:
                best_score = score
                best_p = p_test

        if best_p:
            wire.append(best_p)
            new_v = Vector.ByTwoPoints(p_curr, best_p).Normalized()
            
            # O cão vira o pescoço mais rápido para fazer curvas agudas sem perder o faro
            smooth_v = Vector.ByCoordinates((v_curr.X + new_v.X*2)/3, 
                                            (v_curr.Y + new_v.Y*2)/3, 
                                            (v_curr.Z + new_v.Z*2)/3).Normalized()
            current_vectors[i] = smooth_v
            
            # Remove da piscina pra ninguém mais pegar (evita o cão guloso roubar do vizinho)
            pool.remove(best_p)
        else:
            # Se não achou ninguém (bater no paredão ou acabar a nuvem), encerra a linha
            active_wires[i] = False
            error_pts.append(p_curr)

# Manda os fios e os pontos de alerta pro nó de desenho
OUT = [wires, error_pts]
# ----------------------------------------
python_saida = Python(IN[0]=python_ordenacao, IN[1]=n4_layer_da_3dpoly)  # CPython3
# ---------- python_saida.python (63 lines) ----------
import clr
clr.AddReference('AcMgd')
clr.AddReference('AcDbMgd')
clr.AddReference('AcCoreMgd')
clr.AddReference('ProtoGeometry')

from Autodesk.AutoCAD.ApplicationServices import *
from Autodesk.AutoCAD.DatabaseServices import *
# OLHA O VECTOR3D AQUI:
from Autodesk.AutoCAD.Geometry import Point3d, Point3dCollection, Vector3d
from Autodesk.AutoCAD.Colors import Color, ColorMethod
from Autodesk.DesignScript.Geometry import Point

data = IN[0]
line_data = data[0] if data[0] else []
error_pts = data[1] if data[1] else []
layer_name = str(IN[1])

doc = Application.DocumentManager.MdiActiveDocument
db = doc.Database

def dyn_to_acad(pt):
    return Point3d(pt.X, pt.Y, pt.Z)

with doc.LockDocument():
    with db.TransactionManager.StartTransaction() as t:
        try:
            btr = t.GetObject(db.CurrentSpaceId, OpenMode.ForWrite)
            lt = t.GetObject(db.LayerTableId, OpenMode.ForRead)
            
            # 1. Desenha as Polilinhas construídas até bater no erro
            final_layer = layer_name if lt.Has(layer_name) else "0"
            for line in line_data:
                if len(line) > 1:
                    ac_pts = Point3dCollection()
                    for p in line: ac_pts.Add(dyn_to_acad(p))
                    poly = Polyline3d(Poly3dType.SimplePoly, ac_pts, False)
                    poly.Layer = final_layer
                    btr.AppendEntity(poly)
                    t.AddNewlyCreatedDBObject(poly, True)

            # 2. Desenha o alerta no exato lugar onde o robô parou
            if error_pts:
                if not lt.Has("ERRO_AUTOMACAO"):
                    lt.UpgradeOpen()
                    nltr = LayerTableRecord()
                    nltr.Name = "ERRO_AUTOMACAO"
                    nltr.Color = Color.FromColorIndex(ColorMethod.ByAci, 1)
                    lt.Add(nltr)
                    t.AddNewlyCreatedDBObject(nltr, True)
                
                for err_p in error_pts:
                    circ = Circle(dyn_to_acad(err_p), Vector3d.ZAxis, 0.50)
                    circ.Layer = "ERRO_AUTOMACAO"
                    circ.ColorIndex = 1 
                    btr.AppendEntity(circ)
                    t.AddNewlyCreatedDBObject(circ, True)

            t.Commit()
            OUT = "Polilinhas criadas! Em caso de círculos vermelhos, verifique a conformação dos pontos. Para acessar mais ferramentas Dynamo, entre em contato: https://www.linkedin.com/in/carlos-oliveira-038919259."
        except Exception as e:
            t.Abort()
            OUT = "Erro: " + str(e)
# ----------------------------------------
RESULTADO = Watch(python_saida)  # graph output
