# Dynamo graph BREAKLINE EXTRACTOR - VETORIZAÇÃO DE TALUDES.dyn (Dynamo 3.3.1.7726)
# author: Carlos M. G. Oliveira
# Ferramenta focada na extração de cristas e pés de talude em superfícies ruidosas. O usuário fornece uma linha guia indicando a direção do talude, e o script executa um fatiamento transversal (Cross-Sectioning) ao longo desse eixo. O algoritmo lê o perfil 2D de cada fatia para encontrar as quebras de relevo e constrói as Polilinhas 3D correspondentes. Inclui filtros ajustáveis para ignorar ruídos, fundir cristas muito próximas (bicos de leira) e suavizar a geometria final.

n1_selecione_a_superfície = ObjectSelection()  # "1. SELECIONE A SUPERFÍCIE"; 1 picked in the model; graph input
n2_selecione_a_linha_base = ObjectSelection()  # "2. SELECIONE A LINHA BASE"; 1 picked in the model; graph input
n3_passo_do_fatiador_m = DoubleSlider(2, range=0..100 step 0.1)  # "3. PASSO DO FATIADOR (m)"; graph input
n4_largura_da_varredura_m = DoubleSlider(300, range=0..500 step 0.1)  # "4. LARGURA DA VARREDURA (m)"; graph input
n5_corte_de_declividade = DoubleSlider(25, range=0..100 step 0.1)  # "5. CORTE DE DECLIVIDADE (%)"; graph input
n6_tolerância_para_a_união_de = DoubleSlider(1, range=0..100 step 0.1)  # "6. TOLERÂNCIA PARA A UNIÃO DE LINHAS (m)"; graph input
n7_fator_de_suavização_m = DoubleSlider(1, range=0..100 step 0.1)  # "7. FATOR DE SUAVIZAÇÃO (m)"; graph input
n8_linhas_definitivas = BoolSelector(false)  # "8. LINHAS DEFINITIVAS"; graph input
python_script = Python(IN[0]=n1_selecione_a_superfície, IN[1]=n2_selecione_a_linha_base, IN[2]=n3_passo_do_fatiador_m, IN[3]=n4_largura_da_varredura_m, IN[4]=n5_corte_de_declividade, IN[5]=n6_tolerância_para_a_união_de, IN[6]=n7_fator_de_suavização_m, IN[7]=n8_linhas_definitivas)  # CPython3
# ---------- python_script.python (310 lines) ----------
# CIVIL 3D NEXUS - AUTOMATION
# TOOL 02: Smart Extractor V9 (Cross-Section & Skeletonization)

import sys
import clr
import math

clr.AddReference('acmgd')
clr.AddReference('acdbmgd')
clr.AddReference('AeccDbMgd')

from Autodesk.AutoCAD.ApplicationServices import *
from Autodesk.AutoCAD.DatabaseServices import *
from Autodesk.AutoCAD.Geometry import *
from Autodesk.Civil.DatabaseServices import *
from Autodesk.AutoCAD.Colors import Color, ColorMethod

# -------------------------------------------------------------
# INPUTS
# -------------------------------------------------------------
surf_input = IN[0]
poly_input = IN[1]

try: step_dist = float(IN[2])
except: step_dist = 2.0

try: sweep_width = float(IN[3])
except: sweep_width = 40.0

try: slope_cut = float(IN[4])
except: slope_cut = 25.0

try: merge_tol = float(IN[5])
except: merge_tol = 0.8

try: smooth_tol = float(IN[6])
except: smooth_tol = 1.5

bake_mode = bool(IN[7])

# INTERNAL PARAMS
SAMPLE_RES = 0.5 # A cada 0.5m na costela, ele lê o Z do terreno

# NOVO: Garante um raio de busca mínimo de 8 metros para pular falhas da malha
STITCH_MAX_DIST = max(step_dist * 3.0, 7.0)

adoc = Application.DocumentManager.MdiActiveDocument
db = adoc.Database

# -------------------------------------------------------------
# FUNÇÕES DE GEOMETRIA
# -------------------------------------------------------------
def get_elevation(surf, x, y):
    try:
        return surf.FindElevationAtXY(x, y)
    except:
        return None

def simplify_polyline(points, epsilon):
    if len(points) < 3 or epsilon <= 0.001: return points
    def pt_line_dist(pt, start, end):
        x0, y0 = pt[0], pt[1]
        x1, y1 = start[0], start[1]
        x2, y2 = end[0], end[1]
        num = abs((y2 - y1)*x0 - (x2 - x1)*y0 + x2*y1 - y2*x1)
        den = math.sqrt((y2 - y1)**2 + (x2 - x1)**2)
        if den == 0: return math.sqrt((x0 - x1)**2 + (y0 - y1)**2)
        return num / den

    stack = [(0, len(points) - 1)]
    keep = [False] * len(points)
    keep[0], keep[-1] = True, True
    while stack:
        start, end = stack.pop()
        dmax = 0.0
        index = start
        for i in range(start + 1, end):
            d = pt_line_dist(points[i], points[start], points[end])
            if d > dmax:
                index, dmax = i, d
        if dmax >= epsilon:
            keep[index] = True
            stack.append((start, index))
            stack.append((index, end))
    return [points[i] for i in range(len(points)) if keep[i]]

# -------------------------------------------------------------
# MOTOR PRINCIPAL
# -------------------------------------------------------------
doclock = adoc.LockDocument()
t = db.TransactionManager.StartTransaction()

try:
    if not hasattr(surf_input, 'InternalObjectId'):
        raise ValueError("Selecione a Superfície!")
    if not hasattr(poly_input, 'InternalObjectId'):
        raise ValueError("Selecione a Linha Guia!")
        
    tinsurf = t.GetObject(surf_input.InternalObjectId, OpenMode.ForRead)
    guide_curve = t.GetObject(poly_input.InternalObjectId, OpenMode.ForRead)
    
    total_len = guide_curve.Length
    num_steps = int(total_len / step_dist)
    
    all_crests = []
    all_toes = []
    
    # 1. FATIAMENTO (Criando as Costelas)
    for i in range(num_steps + 1):
        dist = min(i * step_dist, total_len)
        pt_on_curve = guide_curve.GetPointAtDist(dist)
        deriv = guide_curve.GetFirstDerivative(pt_on_curve)
        
        # Vetor Perpendicular 2D (Rotaciona 90 graus)
        normal = Vector2d(-deriv.Y, deriv.X).GetNormal()
        
        # Cria a linha de seção (costela)
        section_pts = []
        half_sweep = sweep_width / 2.0
        
        # Varre da esquerda para a direita ao longo da normal
        samples = int(sweep_width / SAMPLE_RES)
        for s in range(samples + 1):
            offset = -half_sweep + (s * SAMPLE_RES)
            px = pt_on_curve.X + (normal.X * offset)
            py = pt_on_curve.Y + (normal.Y * offset)
            pz = get_elevation(tinsurf, px, py)
            
            if pz is not None:
                section_pts.append((px, py, pz, offset))
                
# 2. ANÁLISE DO PERFIL 2D E FILTRO ANTI-RUÍDO
        sect_crests = []
        sect_toes = []
        
        if len(section_pts) > 4:
            # --- NOVO: FILTRO DE MÉDIA MÓVEL (Amortecedor de pedras/ruídos) ---
            # Suaviza a fatia 2D antes de calcular a declividade
            smoothed_pts = []
            for s in range(len(section_pts)):
                start_idx = max(0, s - 1)
                end_idx = min(len(section_pts) - 1, s + 1)
                # Tira a média do Z com o vizinho da frente e de trás
                avg_z = sum(section_pts[k][2] for k in range(start_idx, end_idx + 1)) / (end_idx - start_idx + 1)
                smoothed_pts.append((section_pts[s][0], section_pts[s][1], avg_z, section_pts[s][3]))
            
            section_pts = smoothed_pts # Substitui a fatia ruidosa pela fatia suave
            # ------------------------------------------------------------------

            states = [] # False = Flat, True = Steep
            # Calcula as inclinações dos segmentos da costela
            for j in range(len(section_pts)-1):
                p1 = section_pts[j]
                p2 = section_pts[j+1]
                dz = p2[2] - p1[2]
                dx = p2[3] - p1[3]
                slope = abs(dz / dx) * 100.0 if dx != 0 else 0
                states.append((slope >= slope_cut, p1, p2, dz))
                
            # Identifica as quebras
            for j in range(len(states)-1):
                s1, s2 = states[j], states[j+1]
                steep1, ptA, ptB, dz1 = s1
                steep2, ptC, ptD, dz2 = s2
                
                if steep1 != steep2:
                    mid_pt = ptB # Ponto de articulação
                    
                    # Flat -> Steep (Começou a cair/subir)
                    if not steep1 and steep2:
                        if dz2 < 0: sect_crests.append(mid_pt) # Caiu = Crista
                        else: sect_toes.append(mid_pt)         # Subiu = Pé
                    
                    # Steep -> Flat (Parou de cair/subir)
                    elif steep1 and not steep2:
                        if dz1 < 0: sect_toes.append(mid_pt)   # Parou de cair = Pé
                        else: sect_crests.append(mid_pt)       # Parou de subir = Crista

        # 3. A SUA MÁGICA: MERGE DE LEIRAS (O Bico)
        def merge_close_points(pts, tol):
            if not pts: return []
            merged = []
            curr_group = [pts[0]]
            for j in range(1, len(pts)):
                p_prev = pts[j-1]
                p_curr = pts[j]
                dist_2d = abs(p_curr[3] - p_prev[3]) # Distância ao longo da costela
                if dist_2d <= tol:
                    curr_group.append(p_curr)
                else:
                    # Tira a média XYZ do grupo
                    mx = sum(p[0] for p in curr_group) / len(curr_group)
                    my = sum(p[1] for p in curr_group) / len(curr_group)
                    mz = sum(p[2] for p in curr_group) / len(curr_group)
                    moff = sum(p[3] for p in curr_group) / len(curr_group)
                    merged.append((mx, my, mz, moff))
                    curr_group = [p_curr]
            
            # Adiciona o último grupo
            if curr_group:
                mx = sum(p[0] for p in curr_group) / len(curr_group)
                my = sum(p[1] for p in curr_group) / len(curr_group)
                mz = sum(p[2] for p in curr_group) / len(curr_group)
                moff = sum(p[3] for p in curr_group) / len(curr_group)
                merged.append((mx, my, mz, moff))
            return merged

        sect_crests = merge_close_points(sect_crests, merge_tol)
        sect_toes = merge_close_points(sect_toes, merge_tol)
        
        all_crests.append(sect_crests)
        all_toes.append(sect_toes)

    # 4. A COSTURA 3D (Ligando as fatias)
    def stitch_sections(sections_data):
        lines = []
        if not sections_data: return lines
        
        # Inicia as linhas com os pontos da primeira fatia válida
        active_lines = []
        for sect in sections_data:
            if sect:
                active_lines = [[p] for p in sect]
                break
                
        for i in range(1, len(sections_data)):
            current_pts = sections_data[i]
            if not current_pts: continue
            
            used_pts = set()
            for al in active_lines:
                last_pt = al[-1]
                best_match = None
                best_dist = STITCH_MAX_DIST
                
                for idx, cp in enumerate(current_pts):
                    if idx in used_pts: continue
                    dist_3d = math.sqrt((last_pt[0]-cp[0])**2 + (last_pt[1]-cp[1])**2 + (last_pt[2]-cp[2])**2)
                    
                    if dist_3d < best_dist:
                        best_dist = dist_3d
                        best_match = idx
                        
                if best_match is not None:
                    al.append(current_pts[best_match])
                    used_pts.add(best_match)
            
            # Se sobrou ponto novo na fatia, começa uma linha nova
            for idx, cp in enumerate(current_pts):
                if idx not in used_pts:
                    active_lines.append([cp])
                    
        return [line for line in active_lines if len(line) > 2] # Remove pontinhos isolados

    final_crests = stitch_sections(all_crests)
    final_toes = stitch_sections(all_toes)
    
    # 5. SUAVIZAÇÃO E DESENHO
    final_crests = [simplify_polyline(p, smooth_tol) for p in final_crests]
    final_toes = [simplify_polyline(p, smooth_tol) for p in final_toes]

    layer_crista = "TOPO-CRISTA" if bake_mode else "_TEMP_CRISTA"
    layer_pe = "TOPO-PE" if bake_mode else "_TEMP_PE"
    
    lt = t.GetObject(db.LayerTableId, OpenMode.ForWrite)
    for l_name, l_color in [(layer_crista, 1), (layer_pe, 3)]:
        if not lt.Has(l_name):
            new_layer = LayerTableRecord()
            new_layer.Name = l_name
            new_layer.Color = Color.FromColorIndex(ColorMethod.ByAci, l_color)
            lt.Add(new_layer)
            t.AddNewlyCreatedDBObject(new_layer, True)

    msId = SymbolUtilityServices.GetBlockModelSpaceId(db)
    ms = t.GetObject(msId, OpenMode.ForWrite)

    for obj_id in ms:
        ent = t.GetObject(obj_id, OpenMode.ForWrite)
        if ent.Layer == "_TEMP_CRISTA" or ent.Layer == "_TEMP_PE":
            ent.Erase()

    linhas_c = 0
    linhas_p = 0
    for poly_list, target_layer in [(final_crests, layer_crista), (final_toes, layer_pe)]:
        for p_pts in poly_list:
            if len(p_pts) < 2: continue
            pts3d = Point3dCollection()
            for p in p_pts: pts3d.Add(Point3d(p[0], p[1], p[2]))
            poly3d = Polyline3d(Poly3dType.SimplePoly, pts3d, False)
            poly3d.Layer = target_layer
            ms.AppendEntity(poly3d)
            t.AddNewlyCreatedDBObject(poly3d, True)
            if target_layer == layer_crista: linhas_c += 1
            else: linhas_p += 1

    t.Commit()
    
    OUT = "### NEXUS V9: FATIADOR GUIADO ###\n\n"
    OUT += "Fatias Processadas: {}\n".format(num_steps)
    OUT += "Modo: {}\n".format("DEFINITIVO" if bake_mode else "RASCUNHO")
    OUT += "\n-> CRISTAS EXTRAÍDAS: {}\n".format(linhas_c)
    OUT += "-> PÉS EXTRAÍDOS: {}\n".format(linhas_p)

except Exception as ex:
    if 't' in locals(): t.Abort()
    import traceback
    OUT = "ERRO:\n" + traceback.format_exc()
finally:
    if 't' in locals(): t.Dispose()
    doclock.Dispose()
# ----------------------------------------
RESUMO = Watch(python_script)
