# Dynamo graph COTA x ÁREA x VOLUME - TIN SURFACE.dyn (Dynamo 3.3.1.7726)
# author: Carlos M. G. Oliveira
# Automação para fatiamento e cubagem de Superfícies TIN no Civil 3D. A ferramenta processa topografias de alta complexidade (múltiplos picos, depressões, ilhas e formas irregulares) com precisão. Utilizando o rigoroso método das Áreas Médias (Average End Area) entre planos de elevação, o script fatia o modelo digital em intervalos customizáveis, entregando relatórios instantâneos de área, volume incremental e volume acumulado. Ideal para curvas cota-volume de reservatórios, medição de bancadas de cava e cubagem de pilhas de minério.

n1_selecione_a_superfície = ObjectSelection()  # "1. SELECIONE A SUPERFÍCIE"; 1 picked in the model; graph input
n2_elevação_máxima_para_o_cálculo = DoubleInput(0)  # "2. ELEVAÇÃO MÁXIMA PARA O CÁLCULO"; graph input
n3_espaçamento_opcional = DoubleSlider(0, range=0..100 step 0.1)  # "3. ESPAÇAMENTO (opcional)"; graph input
n5_ponto_de_inserção_da_tabela = PickPoint()  # "5. PONTO DE INSERÇÃO DA TABELA"; 1 picked in the model; graph input
python_script = Python(IN[0]=n1_selecione_a_superfície, IN[1]=n2_elevação_máxima_para_o_cálculo, IN[2]=n3_espaçamento_opcional, IN[3]=n5_ponto_de_inserção_da_tabela)  # CPython3
# ---------- python_script.python (238 lines) ----------
# CIVIL 3D NEXUS - TABLE GENERATOR V10.1 (SÓLIDO ESCAVADO / TOLERÂNCIA ZERO)
import sys
import clr

# Referências
clr.AddReference('AcMgd')
clr.AddReference('AcDbMgd')
clr.AddReference('AeccDbMgd')
clr.AddReference('ProtoGeometry')

import Autodesk.AutoCAD.DatabaseServices as AcDb
import Autodesk.Civil.DatabaseServices as CivDb
from Autodesk.AutoCAD.ApplicationServices import Application
from Autodesk.AutoCAD.Geometry import Point3d

# --- INPUTS ---
surf_input = IN[0]
user_max_input = IN[1]       # Cota Máxima (Opcional, 0 = Automático)
step_input = IN[2]           # Espaçamento (Opcional, 0 = Automático)
insert_pt_dynamo = IN[3]     # Ponto de Inserção

adoc = Application.DocumentManager.MdiActiveDocument

def to_br(val):
    """Formatação PT-BR"""
    if val is None: return "0,000"
    s = "{:,.3f}".format(val)
    return s.replace(',', 'X').replace('.', ',').replace('X', '.')

def pt_key(p):
    """Gera chave única para o vértice para o rastreamento da borda"""
    return "{:.6f},{:.6f},{:.6f}".format(p.X, p.Y, p.Z)

def calculate_prism_properties(triangles_list, z):
    """Integra a área e o volume de uma lista de triângulos 3D abaixo de um plano Z"""
    total_area = 0.0
    total_vol = 0.0
    for A, z1, z2, z3 in triangles_list:
        if z <= z1:
            continue
        elif z >= z3:
            total_area += A
            total_vol += A * (z - (z1 + z2 + z3) / 3.0)
        else:
            D1 = z2 - z1
            D2 = z3 - z1
            D3 = z3 - z2
            if z <= z2:
                total_area += A * ((z - z1)**2) / (D1 * D2)
                total_vol += A * ((z - z1)**3) / (3.0 * D1 * D2)
            else:
                term1 = (z3 - z)**2 / (D2 * D3)
                total_area += A * (1.0 - term1)
                
                v_z2 = A * (D1**2) / (3.0 * D2)
                v_z = v_z2 + A * (z - z2) + A * ((z3 - z)**3) / (3.0 * D2 * D3) - A * (D3**2) / (3.0 * D2)
                total_vol += v_z
    return total_area, total_vol

def create_acad_table_v10_1():
    if insert_pt_dynamo is None: return "Erro: Ponto de inserção vazio."
    
    ins_pt = Point3d(insert_pt_dynamo.X, insert_pt_dynamo.Y, 0)
    
    lock = adoc.LockDocument()
    try:
        t = adoc.Database.TransactionManager.StartTransaction()
        try:
            # --- 1. Validação ---
            try:
                baseId = surf_input.InternalObjectId
                surf = t.GetObject(baseId, AcDb.OpenMode.ForRead)
            except:
                t.Abort()
                return "Erro: Superfície inválida."

            if not isinstance(surf, CivDb.TinSurface):
                t.Abort()
                return "Erro: Objeto não é TinSurface."

            # --- 2. Extração da Geometria (Triângulos e Borda) ---
            sump_triangles_data = []
            edges_dict = {}
            
            for tri in surf.GetTriangles(False):
                p1 = tri.Vertex1.Location
                p2 = tri.Vertex2.Location
                p3 = tri.Vertex3.Location
                k1, k2, k3 = pt_key(p1), pt_key(p2), pt_key(p3)
                
                A = abs(0.5 * (p1.X * (p2.Y - p3.Y) + p2.X * (p3.Y - p1.Y) + p3.X * (p1.Y - p2.Y)))
                if A > 0.000001:
                    z_coords = sorted([p1.Z, p2.Z, p3.Z])
                    sump_triangles_data.append((A, z_coords[0], z_coords[1], z_coords[2]))
                
                for u_key, v_key, u_pt, v_pt in [(k1, k2, p1, p2), (k2, k3, p2, p3), (k3, k1, p3, p1)]:
                    if (v_key, u_key) in edges_dict:
                        del edges_dict[(v_key, u_key)]
                    else:
                        edges_dict[(u_key, v_key)] = (u_pt, v_pt)

            # --- 3. Construção da "Tampa Inclinada" Virtual ---
            unique_pts = {}
            for u_pt, v_pt in edges_dict.values():
                unique_pts[pt_key(u_pt)] = u_pt
                unique_pts[pt_key(v_pt)] = v_pt
            
            sum_x = sum_y = sum_z = 0.0
            for pt in unique_pts.values():
                sum_x += pt.X
                sum_y += pt.Y
                sum_z += pt.Z
            n = len(unique_pts)
            if n > 0:
                R = Point3d(sum_x/n, sum_y/n, sum_z/n)
            else:
                t.Abort()
                return "Erro: Superfície sem bordas válidas."
                
            lid_triangles_data = []
            total_lid_area = 0.0
            
            for u_pt, v_pt in edges_dict.values():
                A_signed = 0.5 * (u_pt.X * (v_pt.Y - R.Y) + v_pt.X * (R.Y - u_pt.Y) + R.X * (u_pt.Y - v_pt.Y))
                total_lid_area += A_signed
                
            sign_mult = 1.0 if total_lid_area >= 0 else -1.0
            
            for u_pt, v_pt in edges_dict.values():
                A_signed = 0.5 * (u_pt.X * (v_pt.Y - R.Y) + v_pt.X * (R.Y - u_pt.Y) + R.X * (u_pt.Y - v_pt.Y))
                A = A_signed * sign_mult
                if abs(A) > 1e-9:
                    z_coords = sorted([u_pt.Z, v_pt.Z, R.Z])
                    lid_triangles_data.append((A, z_coords[0], z_coords[1], z_coords[2]))

            props = surf.GetGeneralProperties()
            real_min = props.MinimumElevation
            real_max = props.MaximumElevation
            
            # --- 4. Inputs Opcionais (Tolerância Extrema) ---
            target_max = real_max # Padrão: vai até o bico da crista
            try:
                if user_max_input is not None and str(user_max_input).strip() != "":
                    val = float(user_max_input)
                    # Se o valor digitado (ex: 0) for menor que o fundo, ignora e usa a tampa real
                    if val > real_min:
                        target_max = val
            except:
                pass

            z_list = []
            has_step = False
            try:
                if step_input is not None and str(step_input).strip() != "":
                    step_val = float(step_input)
                    # Só faz fatiamento se o step for maior que zero
                    if step_val > 0:
                        has_step = True
                        current_z = real_min
                        while current_z < target_max - 0.001:
                            z_list.append(current_z)
                            current_z += step_val
                        z_list.append(target_max)
            except:
                pass
                
            if not has_step:
                z_list = [real_min, target_max]

            # --- 5. Cálculo Iterativo do Sólido ---
            data_rows = []
            prev_accum_vol = 0.0
            
            for z in z_list:
                sump_area, sump_vol = calculate_prism_properties(sump_triangles_data, z)
                lid_area, lid_vol = calculate_prism_properties(lid_triangles_data, z)
                
                solid_area = sump_area - lid_area
                solid_vol = sump_vol - lid_vol
                
                if solid_area < 0.0001: solid_area = 0.0
                
                vol_inc = solid_vol - prev_accum_vol
                if vol_inc < 0.0001: vol_inc = 0.0
                
                data_rows.append([
                    to_br(z),
                    to_br(solid_area),
                    to_br(vol_inc),
                    to_br(solid_vol)
                ])
                prev_accum_vol = solid_vol

            # --- 6. Geração da Tabela no AutoCAD ---
            msId = AcDb.SymbolUtilityServices.GetBlockModelSpaceId(adoc.Database)
            btr = t.GetObject(msId, AcDb.OpenMode.ForWrite)
            
            table = AcDb.Table()
            table.SetDatabaseDefaults()
            
            num_rows = len(data_rows) + 2
            table.SetSize(num_rows, 4)
            table.Position = ins_pt
            table.SetColumnWidth(35)
            table.SetRowHeight(8)
            
            if has_step:
                table.SetTextString(0, 0, "MEMÓRIA DE CÁLCULO - SÓLIDO ESCAVADO (COTA x ÁREA x VOL)")
            else:
                table.SetTextString(0, 0, "MEMÓRIA DE CÁLCULO - VOLUME TOTAL DO SÓLIDO")
                
            headers = ["COTA (m)", "ÁREA DA SEÇÃO (m²)", "VOLUME PARCIAL (m³)", "VOL. ACUMULADO (m³)"]
            for c in range(4): table.SetTextString(1, c, headers[c])
            
            for i, row in enumerate(data_rows):
                idx = i + 2
                if idx < num_rows:
                    for c in range(4): table.SetTextString(idx, c, row[c])
            
            btr.AppendEntity(table)
            t.AddNewlyCreatedDBObject(table, True)
            
            t.Commit()
            return "Sucesso: Tabela Sólido Escavado V10.1 Gerada."
            
        except Exception as e:
            t.Abort()
            import traceback
            return "Erro Interno: " + str(e) + "\n" + traceback.format_exc()
        finally:
            t.Dispose()
            
    except Exception as e_lock:
        return "Erro Lock: " + str(e_lock)
    finally:
        if lock: lock.Dispose()

OUT = create_acad_table_v10_1()
# ----------------------------------------
watch = Watch(python_script)
