# Dynamo graph GERADOR DE LOCAÇÃO.dyn (Dynamo 3.3.1.7726)
# author: Carlos M. G. Oliveira
# Automação para criação em massa de CogoPoints a partir de múltiplos eixos simultâneos no Civil 3D. Gera listas de coordenadas prontas para locação em campo (GNSS RTK), mantendo a numeração de pontos contínua entre diferentes linhas. Extremamente flexível, permite locar por estaqueamento, extrair apenas vértices ou mesclar ambos. Conta com um algoritmo inteligente de formatação PNEZD que concatena estacas e descrições, garantindo uma importação 100% limpa e à prova de bugs no Civil 3D..
# packages: Civil3DToolkit 1.1.32

n1_selecionar_linha = ObjectsSelection()  # "1. SELECIONAR LINHA"; 1 picked in the model; graph input
geometry = Autodesk.AutoCAD.DynamoNodes.Object.Geometry(object=n1_selecionar_linha)
n2_locar_somente_os_vértices = BoolSelector(true)  # "2. LOCAR SOMENTE OS VÉRTICES"; graph input
n3_intervalo_entre_os_pontos = DoubleInput(10)  # "3. INTERVALO ENTRE OS PONTOS"; graph input
n4_estaqueamento = DoubleInput(0)  # "4. ESTAQUEAMENTO"; graph input
n5_estaca_inicial = DoubleInput(0)  # "5. ESTACA INICIAL"; graph input
n6_inclui_vértices_na_locação = BoolSelector(false)  # "6. INCLUI VÉRTICES NA LOCAÇÃO"; graph input
n7_descrição_dos_pontos = StringInput("teste")  # "7. DESCRIÇÃO DOS PONTOS"; graph input
python_script = Python(IN[0]=geometry, IN[1]=n2_locar_somente_os_vértices, IN[2]=n3_intervalo_entre_os_pontos, IN[3]=n4_estaqueamento, IN[4]=n5_estaca_inicial, IN[5]=n6_inclui_vértices_na_locação, IN[6]=n7_descrição_dos_pontos)  # CPython3; graph output
# ---------- python_script.python (134 lines) ----------
import sys
import clr

# Bibliotecas de Geometria
clr.AddReference('ProtoGeometry')
from Autodesk.DesignScript.Geometry import *

# --- ENTRADAS (IN[0] a IN[6]) ---
curvas_input = IN[0]            
somente_vertices = IN[1]        
intervalo = float(IN[2])        
base_estaca = float(IN[3])      
estaca_inicial = float(IN[4])   
incluir_v = IN[5]               
desc_manual = IN[6]             

# --- INICIALIZAÇÃO ---
linhas_txt = []
pontos_gerados = []
descricoes_final = []

# NOVO: Rastreador de coordenadas para evitar pontos duplicados
coordenadas_vistas = set() 

if not isinstance(curvas_input, list):
    curvas_input = [curvas_input]

# O contador global para numeração contínua!
contador_pontos = 1

try:
    for curva in curvas_input:
        if not curva:
            continue
            
        dist_total = curva.Length
        dists = []
        
        # 1. LÓGICA DE DISTÂNCIAS
        if somente_vertices:
            dists.append(0.0)
            try:
                acumulado = 0.0
                for s in curva.Curves():
                    acumulado += s.Length
                    dists.append(acumulado)
            except:
                dists.append(dist_total)
        else:
            d = 0.0
            while d <= dist_total + 0.001:
                dists.append(d)
                d += intervalo
            dists.append(dist_total)
            
            if incluir_v:
                dists.append(0.0)
                try:
                    acumulado = 0.0
                    for s in curva.Curves():
                        acumulado += s.Length
                        dists.append(acumulado)
                except:
                    dists.append(dist_total)
        
        dists_ordenadas = sorted(list(set([round(x, 4) for x in dists])))
        
        # 2. GERAÇÃO DE PONTOS E TEXTO
        for d in dists_ordenadas:
            dist_ajustada = min(d, dist_total)
            pt = curva.PointAtSegmentLength(dist_ajustada)
            
            # --- NOVO: FILTRO DE DUPLICATAS POR COORDENADA ---
            # Cria uma chave única baseada no X, Y, Z com 4 casas decimais
            coord_key = (round(pt.X, 4), round(pt.Y, 4), round(pt.Z, 4))
            
            if coord_key in coordenadas_vistas:
                continue 
                
            coordenadas_vistas.add(coord_key) # Salva a coordenada na memória
            # -------------------------------------------------
            
            pontos_gerados.append(pt)
            
            # Montagem das 4 primeiras colunas (P, N, E, Z)
            colunas = [
                str(contador_pontos),
                "{:.4f}".format(pt.Y),
                "{:.4f}".format(pt.X),
                "{:.4f}".format(pt.Z)
            ]
            
            # --- LÓGICA INTELIGENTE DE DESCRIÇÃO ---
            texto_estaca = ""
            if base_estaca > 0:
                dist_real = dist_ajustada + estaca_inicial
                inteiro = int(dist_real // base_estaca)
                resto = dist_real % base_estaca
                texto_estaca = "{}+{:06.3f}".format(inteiro, resto)
            
            texto_desc = ""
            if desc_manual and str(desc_manual).strip():
                texto_desc = str(desc_manual).strip()
                
            # Junta os dois sem usar vírgula!
            partes_desc = []
            if texto_desc:
                partes_desc.append(texto_desc)
            if texto_estaca:
                partes_desc.append(texto_estaca)
                
            descricao_final = " - ".join(partes_desc)
            
            # Se a pessoa não preencheu nada, coloca algo padrão pra não dar erro
            if not descricao_final:
                descricao_final = "PNEZ"
                
            # Adiciona a 5ª e última coluna
            colunas.append(descricao_final)
            descricoes_final.append(descricao_final)
            
            # Transforma tudo em linha de texto
            linha_final = ",".join(colunas)
            linhas_txt.append(linha_final)
            
            contador_pontos += 1

    status = "Sucesso! {} pontos processados em {} linha(s).\nPara acessar mais ferramentas Dynamo, entre em contato: https://www.linkedin.com/in/carlos-oliveira-038919259".format(len(linhas_txt), len(curvas_input))

except Exception as e:
    status = "Erro no processamento: " + str(e)

# --- SAÍDAS ---
OUT = [linhas_txt, pontos_gerados, descricoes_final, status]
# ----------------------------------------
code_block = CodeBlock(lista=python_script) { lista[0]; lista[1]; lista[2]; }
byGeometry = Autodesk.Civil.DynamoNodes.CogoPoint.ByGeometry(point=code_block.out1)
setRawDescription = Autodesk.Civil.DynamoNodes.CogoPoint.SetRawDescription(cogoPoint=byGeometry, rawDescription=code_block.out2)
n8_nome_do_grupo_de_pontos = StringInput("teste")  # "8. NOME DO GRUPO DE PONTOS"; graph input
byCogoPoints = Autodesk.Civil.DynamoNodes.CogoPointGroup.ByCogoPoints(cogoPoints=setRawDescription, cogoPointGroupName=n8_nome_do_grupo_de_pontos)
pick_point = PickPoint()  # nothing selected
