# Dynamo graph SPOTBLOCK - INSERÇÃO DE BLOCOS.dyn "INSERÇÃO DE BLOCOS" (Dynamo 3.3.1.7726)
# author: Carlos M. G. Oliveira
# Insere blocos do AutoCAD de forma automática e em lote nas coordenadas exatas dos pontos do Civil 3D. Otimiza a representação gráfica de levantamentos (árvores, infraestrutura, etc.). Pré-requisito: O bloco a ser utilizado deve estar previamente inserido/carregado no DWG ativo. Configurações parametrizáveis conforme a necessidade do projeto.

n1_selecione_os_layers = ObjectsSelection()  # "1. SELECIONE OS LAYERS"; 2 picked in the model; graph input
n2_bloco_para_inserção = ListBlockName("ÁRVORE30_", ItemList=["ÁRVORE30_", "VDDIM_DEFAULT", "VDDIM_NONE"])  # "2. BLOCO PARA INSERÇÃO"; graph input
n3_escala = DoubleInput(1)  # "3. ESCALA"; graph input
n4_rotação = DoubleInput(0)  # "4. ROTAÇÃO"; graph input
python_script = Python(IN[0]=n1_selecione_os_layers, IN[1]=n2_bloco_para_inserção, IN[2]=n3_escala, IN[3]=n4_rotação)  # CPython3
# ---------- python_script.python (127 lines) ----------
# CIVIL 3D NEXUS - AUTOMATION
# Engine: CPython 3 (V 2.2 - Smart Eyedropper + CPython Safe)

import sys
import clr
import math

clr.AddReference('acmgd')
clr.AddReference('acdbmgd')
from Autodesk.AutoCAD.ApplicationServices import *
from Autodesk.AutoCAD.DatabaseServices import *
from Autodesk.AutoCAD.Geometry import *

# -------------------------------------------------------------
# FUNCAO: Desempacotar Listas do Dynamo
# -------------------------------------------------------------
def achatar_lista(raw_input):
    if isinstance(raw_input, list):
        res = []
        for item in raw_input:
            res.extend(achatar_lista(item))
        return res
    return [raw_input]

# -------------------------------------------------------------
# INPUTS
# -------------------------------------------------------------
raw_samples = IN[0]
sample_objs = achatar_lista(raw_samples)

block_name = str(IN[1]).strip()
scale_val = float(IN[2]) if IN[2] is not None else 1.0
rot_deg = float(IN[3]) if IN[3] is not None else 0.0

adoc = Application.DocumentManager.MdiActiveDocument
db = adoc.Database

def get_original_block_layer(btr, t, b_name):
    for obj_id in btr:
        ent = t.GetObject(obj_id, OpenMode.ForRead)
        if isinstance(ent, BlockReference):
            try:
                if ent.Name.upper() == b_name.upper():
                    return ent.Layer
            except:
                pass
    return None

# -------------------------------------------------------------
# TRANSACAO PRINCIPAL
# -------------------------------------------------------------
doclock = adoc.LockDocument()
t = db.TransactionManager.StartTransaction()

try:
    # 1. Extrai Layers das Amostras
    target_layers = set()
    for obj in sample_objs:
        if obj is not None and hasattr(obj, 'InternalObjectId'):
            ent = t.GetObject(obj.InternalObjectId, OpenMode.ForRead)
            target_layers.add(ent.Layer.strip().upper())
            
    if not target_layers:
        raise ValueError("O Script nao conseguiu extrair nenhum layer da sua selecao.")

    # 2. Acesso Seguro ao ModelSpace (Sem colchetes)
    msId = SymbolUtilityServices.GetBlockModelSpaceId(db)
    ms = t.GetObject(msId, OpenMode.ForWrite)
    
    # 3. Acesso Seguro a Tabela de Blocos (Sem colchetes)
    bt = t.GetObject(db.BlockTableId, OpenMode.ForRead)
    if not bt.Has(block_name):
        raise ValueError("O bloco '{}' nao existe neste arquivo.".format(block_name))
    
    # Busca a ID do bloco varrendo a tabela (A prova de bugs do Dynamo)
    block_def_id = None
    for b_id in bt:
        b_rec = t.GetObject(b_id, OpenMode.ForRead)
        if b_rec.Name.upper() == block_name.upper():
            block_def_id = b_id
            break
            
    if block_def_id is None:
        raise ValueError("Falha ao carregar a definicao do bloco.")

    target_block_layer = get_original_block_layer(ms, t, block_name)
    layer_destino = target_block_layer if target_block_layer else "Layer Atual (Nao achou original)"
    
    # 4. Varre o Model Space buscando os pontos
    pts_to_insert = []
    
    for obj_id in ms:
        ent = t.GetObject(obj_id, OpenMode.ForRead)
        if isinstance(ent, DBPoint):
            if ent.Layer.strip().upper() in target_layers:
                pts_to_insert.append(ent.Position)
    
    if not pts_to_insert:
        raise ValueError("Layers lidos: {}. \nNenhum Ponto encontrado nesses layers específicos.".format(", ".join(target_layers)))

    # 5. Cria e Insere os Blocos
    blocos_inseridos = 0
    rot_rad = math.radians(rot_deg)
    scale_3d = Scale3d(scale_val)
    
    for pt in pts_to_insert:
        br = BlockReference(pt, block_def_id)
        br.ScaleFactors = scale_3d
        br.Rotation = rot_rad
        
        if target_block_layer:
            br.Layer = target_block_layer
            
        ms.AppendEntity(br)
        t.AddNewlyCreatedDBObject(br, True)
        blocos_inseridos += 1

    t.Commit()
    OUT = "SUCESSO!\nLayers lidos: {}\nBlocos '{}' inseridos: {}\nLayer de Destino: {}".format(
        ", ".join(target_layers), block_name, blocos_inseridos, layer_destino)

except Exception as ex:
    if 't' in locals(): t.Abort()
    OUT = "DIAGNOSTICO:\n" + str(ex)
finally:
    if 't' in locals(): t.Dispose()
    doclock.Dispose()
# ----------------------------------------
watch = Watch(python_script)  # graph output
