# Dynamo graph SURFACE GRID BUILDER - PRÉ-PROCESSAMENTO.dyn (Dynamo 3.3.1.7726)
# author: Carlos M. G. Oliveira
# Ferramenta de pré-processamento essencial para fluxos de trabalho com drones. Ela automatiza a reamostragem de superfícies TIN irregulares e ruidosas em malhas de grid estruturadas e regulares. Ao capturar a elevação em intervalos fixos definidos pelo usuário (ex: 1x1m), o algoritmo filtra efetivamente o "ruído" e a granulação típicos da fotogrametria, gerando um modelo digital de terreno (MDT) limpo, leve e uniforme, ideal como base para análises precisas e extração automática de linhas de quebra.

n1_selecionar_superfície_para = ObjectSelection()  # "1. SELECIONAR SUPERFÍCIE PARA ANÁLISE"; 1 picked in the model; graph input
n2_espaçamento_da_malha = DoubleSlider(0.5, range=0..100 step 0.1)  # "2. ESPAÇAMENTO DA MALHA"; graph input
python_script = Python(IN[0]=n1_selecionar_superfície_para, IN[1]=n2_espaçamento_da_malha)  # CPython3
# ---------- python_script.python (87 lines) ----------
# CIVIL 3D NEXUS - AUTOMATION
# TOOL 01: Surface Grid Resampler (O "Alisador" de Drone) - V 1.1 (Correção Extents)

import sys
import clr
import time

clr.AddReference('acmgd')
clr.AddReference('acdbmgd')
clr.AddReference('AeccDbMgd')

from Autodesk.AutoCAD.ApplicationServices import *
from Autodesk.AutoCAD.DatabaseServices import *
from Autodesk.AutoCAD.Geometry import *
from Autodesk.Civil.DatabaseServices import *

# -------------------------------------------------------------
# INPUTS
# -------------------------------------------------------------
surf_input = IN[0]

try: grid_size = float(IN[1])
except: grid_size = 1.0 # Tamanho da malha padrao (1 metro)

adoc = Application.DocumentManager.MdiActiveDocument
db = adoc.Database

# -------------------------------------------------------------
# TRANSACAO PRINCIPAL
# -------------------------------------------------------------
doclock = adoc.LockDocument()
t = db.TransactionManager.StartTransaction()

try:
    if not hasattr(surf_input, 'InternalObjectId'):
        raise ValueError("Selecione uma TIN Surface valida do Civil 3D.")
        
    orig_surf = t.GetObject(surf_input.InternalObjectId, OpenMode.ForRead)
    
    # CORREÇÃO: Pega os limites (Bounding Box) da superfície usando a API nativa
    extents = orig_surf.GeometricExtents
    min_pt = extents.MinPoint
    max_pt = extents.MaxPoint
    
    min_x, min_y = min_pt.X, min_pt.Y
    max_x, max_y = max_pt.X, max_pt.Y
    
    pts_collection = Point3dCollection()
    
    # Cria o Grid e fura a superficie original para descobrir o Z
    curr_x = min_x
    while curr_x <= max_x:
        curr_y = min_y
        while curr_y <= max_y:
            try:
                # Se o XY cair dentro da superficie, ele acha o Z.
                z = orig_surf.FindElevationAtXY(curr_x, curr_y)
                pts_collection.Add(Point3d(curr_x, curr_y, z))
            except:
                pass # Ponto caiu fora da borda da malha, ignora.
            
            curr_y += grid_size
        curr_x += grid_size

    # Cria a NOVA superficie no Civil 3D
    surf_name = "SURFACE_GRID_{}m_{}".format(grid_size, int(time.time()))
    new_surf_id = TinSurface.Create(db, surf_name)
    new_surf = t.GetObject(new_surf_id, OpenMode.ForWrite)
    
    # Adiciona os pontos amostrados nela
    new_surf.AddVertices(pts_collection)

    t.Commit()
    
    OUT = "###RESUMO DA MALHA GERADA ###\n\n"
    OUT += "Grid Utilizado: {} x {} metros\n".format(grid_size, grid_size)
    OUT += "Nova Superficie Criada: {}\n".format(surf_name)
    OUT += "Total de Pontos Gerados: {}\n".format(pts_collection.Count)
    OUT += "\n->Faça a verificação da malha gerada."

except Exception as ex:
    if 't' in locals(): t.Abort()
    import traceback
    OUT = "ERRO:\n" + traceback.format_exc()
finally:
    if 't' in locals(): t.Dispose()
    doclock.Dispose()
# ----------------------------------------
RESUMO = Watch(python_script)  # graph output
