# Dynamo graph Z-CONTOURS - EDITOR DE CURVAS DE NÍVEL.dyn (Dynamo 3.3.1.7726)
# author: Carlos M. G. Oliveira
#  Analisa a coordenada $Z$ de polilinhas (2D e 3D) e as segmenta automaticamente. Curvas com elevação múltipla de 5.00m são classificadas como Curvas Mestras, enquanto as demais são tratadas como Intermediárias.

selecione_as_polilinhas = ObjectsSelection()  # 5956 picked in the model; graph input
python_script = Python(IN[0]=selecione_as_polilinhas)  # CPython3
# ---------- python_script.python (85 lines) ----------
import clr

# Referências fundamentais
clr.AddReference('AcDbMgd')
clr.AddReference('AcMgd')

from Autodesk.AutoCAD.DatabaseServices import *
from Autodesk.AutoCAD.ApplicationServices import *
# AQUI ESTAVA O ERRO: Precisamos importar o ColorMethod também!
from Autodesk.AutoCAD.Colors import Color, ColorMethod 

# Inputs do Dynamo
input_objects = IN[0] if isinstance(IN[0], list) else [IN[0]]

doc = Application.DocumentManager.MdiActiveDocument
db = doc.Database

output = []

# --- FUNÇÃO AUXILIAR CORRIGIDA ---
def set_layer_props(tr, lt, name, color_index):
    if not lt.Has(name):
        lt.UpgradeOpen()
        nlr = LayerTableRecord()
        nlr.Name = name
        # Agora o ColorMethod vai ser reconhecido!
        nlr.Color = Color.FromColorIndex(ColorMethod.ByAci, color_index)
        lt.Add(nlr)
        tr.AddNewlyCreatedDBObject(nlr, True)
    else:
        layer = tr.GetObject(lt[name], OpenMode.ForWrite)
        layer.Color = Color.FromColorIndex(ColorMethod.ByAci, color_index)

# --- EXECUÇÃO SEGURA ---
lock = doc.LockDocument()
try:
    with db.TransactionManager.StartTransaction() as tr:
        lt = tr.GetObject(db.LayerTableId, OpenMode.ForRead)
        
        # Configura as camadas (Mestra e Intermediária)
        set_layer_props(tr, lt, "CURVAS_MESTRAS", 10)
        set_layer_props(tr, lt, "CURVAS_INTERMEDIARIAS", 34)

        for dyn_obj in input_objects:
            if dyn_obj is None: continue
            
            try:
                # Tenta pegar o ID direto, se não der, vai pelo Handle
                try:
                    obj_id = dyn_obj.InternalObjectId
                except:
                    h = Handle(int(dyn_obj.Handle, 16))
                    obj_id = db.GetObjectId(False, h, 0)

                if obj_id.IsNull: continue

                ent = tr.GetObject(obj_id, OpenMode.ForWrite)
                
                # Pega a elevação (Z)
                elev = 0.0
                if hasattr(ent, "Elevation"):
                    elev = ent.Elevation
                elif hasattr(ent, "StartPoint"): # Caso de linhas simples
                    elev = ent.StartPoint.Z
                
                # Lógica: Múltiplos de 5 = Mestra
                if round(elev, 2) % 5 == 0:
                    ent.Layer = "CURVAS_MESTRAS"
                else:
                    ent.Layer = "CURVAS_INTERMEDIARIAS"
                
                ent.ColorIndex = 256 # ByLayer
                output.append("Processado: " + str(round(elev, 2)))

            except Exception as e_item:
                output.append("Erro no item: " + str(e_item))

        tr.Commit()
except Exception as e_geral:
    output.append("Erro Geral: " + str(e_geral))
finally:
    # Destrava o documento para evitar Fatal Error ao sair
    lock.Dispose()

OUT = output
# ----------------------------------------
